# Dynamo graph m001_Маркировка на активном виде.dyn "temp_марка лифтов" (Dynamo 2.3.0.5885)

# group: Задать elements in active view
категория_элементов_на_активном = Categories("OST_SpecialityEquipment")  # "Категория элементов на активном виде"; graph input
имя_семейства_элементов = StringInput("")  # graph input
элементы_семейства_активного = Python(IN[0]=категория_элементов_на_активном, IN[1]=имя_семейства_элементов)  # "элементы семейства активного вида"
# ---------- элементы_семейства_активного.python (31 lines) ----------
# Importing Reference Modules
import clr # CLR (Common Language Runtime Module)
clr.AddReference("RevitServices") # Adding the RevitServices.dll special Dynamo module to deal with Revit
import RevitServices # Importing RevitServices
from RevitServices.Persistence import DocumentManager # From RevitServices import the Document Manager
clr.AddReference("RevitAPI") # Adding the RevitAPI.dll module to access the Revit API
import Autodesk # Here we import the Autodesk namespace
from Autodesk.Revit.DB import FilteredElementCollector, BuiltInCategory, FamilyInstance

# Here we give the Revit Document a nickname of 'doc' which allows us to simply call 'doc' later without having to type the long namespace name 
doc = DocumentManager.Instance.CurrentDBDocument

category = UnwrapElement(IN[0]).Id
# Variable for family name
family_name = IN[1]  # Replace with the desired family name



builtInCollector = FilteredElementCollector(doc, doc.ActiveView.Id) \
    .OfClass(FamilyInstance) \
    .OfCategoryId(category) \
    .WhereElementIsNotElementType() \
    .ToElements()

# Function to filter elements by family name
def filter_by_family_name(elements, family_name):
    filtered_elements = [e for e in elements if e.Symbol.Family.Name == family_name]
    return filtered_elements

filtered_elements = filter_by_family_name(builtInCollector, family_name)
OUT = filtered_elements
# ----------------------------------------

# group: Задать семейство марки
марка_Семейство = StringInput("")  # graph input
марка_Тип = StringInput("")  # graph input
byFamilyNameAndTypeName = FamilyType.ByFamilyNameAndTypeName(familyName=марка_Семейство, typeName=марка_Тип)

# group: Маркировка элементов на активнов виде
current = Document.Current()
activeView = Document.ActiveView(document=current)
byElementAndOffset = Tag.ByElementAndOffset(view=activeView, element=элементы_семейства_активного)
code_block = CodeBlock { "Тип"; }
setParameterByName = Element.SetParameterByName(element=byElementAndOffset, parameterName=code_block, value=byFamilyNameAndTypeName)
